# Grasshopper definition urbanism-scripts.gh (Grasshopper 1.0.8)

brep = Brep([<brep referenced from the Rhino model> x2])
script = Script(brep=brep)  # -> out, lowestHorizontalFaces; inputs brep: tree of Brep
# ---------- script: Python ----------
# Find bottom planar surface of a given Brep
# Rune Wriedt, 2026-06-17

import Rhino.Geometry as rg
from Grasshopper import DataTree
import math

input_brep = brep
planar_tolerance = 0.01
angle_tolerance_degrees = 1
angle_tolerance = math.radians(angle_tolerance_degrees)
world_z = rg.Plane.WorldXY.Normal

plane_origins = DataTree[rg.Point3d]()
plane_normals = DataTree[rg.Vector3d]()
horizontal_faces = DataTree[rg.BrepFace]()

#Helper function to test faces for planarity
def try_face_plane(face, tolerance):
    is_planar, plane = face.TryGetPlane(tolerance)
    return is_planar, (plane if is_planar else None)

#Helper function to test faces for horizontality
def is_near_horizontal(normal, world_z):
    angle = rg.Vector3d.VectorAngle(normal, world_z)    #Find the angle between the normal and world_z
    angle = min(angle, abs(math.pi - angle))            #Get the smallest value (because normal might be -Z)
    return angle <= angle_tolerance                     #Return True if angle is smaller than tolerance

#Main script
for i in range(input_brep.BranchCount):
    path = input_brep.Path(i)
    branch = input_brep.Branch(i)

    for j, brep in enumerate(branch):      #Loop through the breps on the branch 

        
        if not branch[j].IsSolid and branch[j] is not rg.Brep:
            print("Object", j, "on path", path, "is not a valid, closed Brep.")
            continue
        
        brep_faces = branch[j].Faces
        candidates = []

        for k, face in enumerate(brep_faces):   #Loop through the faces on each brep
            
            is_planar, plane = try_face_plane(face, planar_tolerance)
            if not is_planar:
                continue
            if not is_near_horizontal(plane.Normal, world_z):
                continue
            
            face_amp = rg.AreaMassProperties.Compute(face)
            face_centroid = face_amp.Centroid
            centroid_z = face_centroid.Z

            candidates.append((face, centroid_z))

        z_values = []

        for candidate in candidates:
            face = candidate[0]
            centroid_z = candidate[1]

            z_values.append(centroid_z)

        min_z = min(z_values)

        lowest_faces = []
        for candidate in candidates:
            face = candidate[0]
            centroid_z = candidate[1]

            z_difference = abs(centroid_z - min_z)

            if z_difference <= planar_tolerance:
                lowest_faces.append(face)
        
        for face in lowest_faces:
            horizontal_faces.Add(face)

#Return the lowest horizontal faces within tolerance      
lowestHorizontalFaces = horizontal_faces
# ---------- end script ----------
panel = Panel(script.out)
surface = Surface(script.lowestHorizontalFaces)
curve = Curve([<curve referenced from the Rhino model> x6])
curve_2 = Curve([<curve referenced from the Rhino model> x5])
curve_3 = Curve(surface)
entwine = Entwine(Branch00=curve, Branch01=curve_2, Branch02=curve_3, FlattenInputs=True)
get_geometry = GetGeometry(entwine, AnnotationTypeFilter=0, AtLeast=1, AtMost=1, DeleteInput=False, Filter=4, TreeAccess=True)
curve_4 = Curve(get_geometry)
clean_curves = Script(curves=curve_4)  # -> out, closedPlanarCurves; inputs curves: tree of Curve
# ---------- clean_curves: Python ----------
#Script by Rune Wriedt, 2026-06-15
from Grasshopper import DataTree
import Rhino.Geometry as rg
#import rhinoscriptsyntax as rs

input_curves = curves
cleaned_curves = DataTree[rg.Curve]()       # Create an instance of a DataTree which holds Curve objects

for i in range(input_curves.BranchCount):   # Loop through the input data tree
    path = input_curves.Path(i)             # Stores a reference to the current path (a GH_Path object)
    branch = input_curves.Branch(i)         # Stores a reference to the current branch

    for crv in branch:

        if crv is None:
            print("Invalid curve: None")
            continue

        is_closed = crv.IsClosed
        if is_closed == False:
            print(crv, "is not closed")
        
        is_planar = crv.IsPlanar()
        if is_planar == False:
            print(crv, "is not planar")

        if is_closed and is_planar:
            cleaned_curves.Add(crv, path)

closedPlanarCurves = cleaned_curves

print("Number of cleaned curves:", cleaned_curves.DataCount)
# ---------- end clean_curves ----------
panel_2 = Panel(clean_curves.closedPlanarCurves)
curve_5 = Curve(clean_curves.closedPlanarCurves)

# ---- group: Areas of nested curves
script_2 = Script(curves=curve_5, decimalPoint=Slider(2, range=0..10))  # -> out, areas; inputs curves: tree of Curve, tolerance: Double, optionalPlane: Plane, decimalPoint: Int32
# ---------- script_2: Python ----------
#Script by Rune Wriedt, 2026-06-15
from Grasshopper import DataTree
import Rhino.Geometry as rg
#import rhinoscriptsyntax as rs

input_curves = curves
test_plane = optionalPlane
tolerance = tolerance
decimal_point = decimalPoint

total_areas = DataTree[float]()

# Default values
if test_plane is None:
    test_plane = rg.Plane.WorldXY
    print("No optional plane is set, defaulting to", test_plane)
    print()

if tolerance is None:
    tolerance = 0.01
    print("No tolerance is set, defaulting to", tolerance)
    print()

if decimal_point is None:
    decimal_point = 0
    print("No decimal point is set, defaulting to", decimal_point)
    print()

# Main
for i in range(input_curves.BranchCount):
    total_area = 0
    path = input_curves.Path(i)
    branch = input_curves.Branch(i)

    for i, current_crv in enumerate(branch):
        # the enumerate method returns both the index of the items in the list,
        # but also the items themselves, as a tuple

        # Find curve area
        curve_area = 0
        area_properties = rg.AreaMassProperties.Compute(current_crv)

        if area_properties is not None:
            curve_area = area_properties.Area
            print("The area of curve", i, "is", curve_area)

        # Find the nesting depth for each curve
        contained_by_count = 0
        for j, other_crv in enumerate(branch):
            if i == j:
                continue
            crv_relationship = current_crv.PlanarClosedCurveRelationship(
                current_crv,
                other_crv,
                test_plane,
                tolerance
                )
            print("Comparing", i, "against", j, ":", crv_relationship)
            
            if crv_relationship == rg.RegionContainment.AInsideB:
                contained_by_count += 1
        
        print("Curve", i, "is contained by", contained_by_count, "curves")
        
        # If the curve is contained by an even number of curves, it's area is added
        # otherwise, it's area is subtracted
        is_even = contained_by_count % 2 == 0
        if is_even:
            total_area += curve_area
        else:
            total_area -= curve_area

    total_areas.Add(round(total_area, decimal_point), path)
    print("Total area for branch", path, "is", round(total_area, decimal_point))
    print( )

areas = total_areas
# ---------- end script_2 ----------

# ----
panel_3 = Panel(script_2.areas)
number = Number(script_2.areas)
